# Grasshopper definition Aggregate structure new placement positioning.gh (Grasshopper 1.0.7)
# plug-ins: Pufferfish, gHowl

minimum_distance_to_keep_from_existing_s = Slider(2.89, range=0..5)  # "Minimum distance to keep from existing structure"
state_0_tolerance_for_undetection_at_sta = Slider(0.01, range=0.01..1)  # "State 0 Tolerance for undetection at start points"
xz_plane = XZPlane(Origin=Point(0, 0, 0))

# ---- group: INPUTS / Target geometry
# parameters to consider
# 
# - Current positions
# - Amount of branching
# -
# Simple rules of partialily cured agregate structures
# 
# - new unloading position and amount of material (repetitions) should be decided accoring to:
# 1. Viable areas (facing up) to place
# 2. current center of gravity of structure
# 3. Expected direction of structure
# 4. Max distance form end effector to structure
# 
# 
# - infusion and curing should be dicided according to:
# 1. Only infusing in new additions to previous state of structure
# 
# - Possible added information
# 1. Initial Structural analysis of 2d shape could give insight on possible section variations to structure
# 2. Structural analysis could give insight on limits to the placement of more material
curve = Curve(<curve referenced from the Rhino model>)

# ---- group: INPUTS / INPUT Polyline curves
curve_2 = Curve([<curve referenced from the Rhino model> x6])

# ---- group: INPUTS / Base Plane
plane = Plane(xz_plane)

# ---- group: Main Plane Directions
deconstruct_plane = DeconstructPlane(Plane=xz_plane)  # -> Origin, XAxis, YAxis, ZAxis

# ----
local_ip = Panel("192.168.0.106")

port = Panel("5000")
local_ip_2 = Panel("141.58.222.34")
udp = UDPReceiver(Address=local_ip, Port=port, Pattern=0)  # -> Info, Data
panel = Panel(udp.Info)
# ReceivingCameraData
replace_text = ReplaceText(Text=udp.Data, Find="[", RecursiveReplace=False)
replace_text_2 = ReplaceText(Text=replace_text, Find="]", RecursiveReplace=False)
text_split = TextSplit(Text=replace_text_2, Separators=",")  # -> simplify(Result)
xz_plane_2 = XZPlane(Origin=Point(0, 0, 0))
number = Number(text_split)
list_length = ListLength(List=number)
division = Division(A=list_length, B="2")
partition_list = PartitionList(List=number, Size=division)  # -> simplify(Chunks)
explode_tree = ExplodeTree(Data=partition_list)  # -> Branch0, Branch1
number_2 = Number(explode_tree.Branch1)
number_3 = Number(explode_tree.Branch0)
construct_point = ConstructPoint(XCoordinate=number_3, YCoordinate=number_2, ZCoordinate=0)
mirror = Mirror(Geometry=construct_point, Plane=xz_plane_2)  # -> Geometry, Transform
polyline = PolyLine(Vertices=mirror.Geometry, Closed=True)
area = Area(Geometry=polyline)  # -> Area, Centroid

# ---- group: FILTER SELF INTERSECTING CURVES / close curve filter
close_curve = CloseCurve(Curve=curve_2, CloseType=0, Bulge=0.5, Tolerance=0)  # -> Closed, ResultBoolean

# ---- group: FILTER SELF INTERSECTING CURVES / Remove self-intersections
graft_tree = GraftTree(Tree=close_curve.Closed, IncludeEmptyLists=True, IncludeNullItems=True)
curve_self = CurveSelf(Curve=close_curve.Closed)  # -> Points, Params
tree_statistics = TreeStatistics(Tree=graft_tree)  # -> Paths, Length, Count
list_length_2 = ListLength(List=curve_self.Params)  # -> flatten(Length)
shatter = Shatter(Curve=simplify(graft_tree), Parameters=simplify(curve_self.Params))  # -> simplify(Segments)
cull_pattern = CullPattern(List=tree_statistics.Paths, CullPattern=invert(list_length_2))
tree_branch = TreeBranch(Tree=graft_tree, Path=cull_pattern, MaintainPaths=True)  # -> simplify(Branch)
merge = Merge(Data1=tree_branch, Data2=shatter)  # -> flatten(Result)

# ---- group: FILTER SELF INTERSECTING CURVES / Final curves to work with
curve_3 = Curve(flatten(merge))

# ----
panel_2 = Panel(curve_3)

# ---- group: BOUNDARY GENERATOR / Minimum distance from end effector to existing structure
explode = Explode(Curve=curve_3, Recursive=True)  # -> Segments, Vertices
delaunay_mesh = DelaunayMesh(Points=explode.Vertices, Plane=plane)
mesh_edges = MeshEdges(Mesh=delaunay_mesh)  # -> NakedEdges, InteriorEdges, NonManifoldEdges
curve_4 = Curve(mesh_edges.NakedEdges)
join_curves = JoinCurves(Curves=curve_4, Preserve=False)

# ---- group: BOUNDARY GENERATOR
close_curve_2 = CloseCurve(Curve=join_curves, CloseType=0, Bulge=0.5, Tolerance=0)  # -> Closed, ResultBoolean

surface = Surface(close_curve_2.Closed)
area_2 = Area(Geometry=surface)  # -> Area, Centroid
surface_closest_point = SurfaceClosestPoint(Point=area_2.Centroid, Surface=surface)  # -> Point, UVPoint, Distance
evaluate_surface = EvaluateSurface(Surface=surface, Point=surface_closest_point.UVPoint)  # -> Point, Normal, UDirection, VDirection, Frame
deconstruct_vector = DeconstructVector(Vector=evaluate_surface.Normal)  # -> XComponent, YComponent, ZComponent
deconstruct_vector_2 = DeconstructVector(Vector=deconstruct_plane.ZAxis)  # -> XComponent, YComponent, ZComponent
equality = Equality(FirstNumber=deconstruct_vector.XComponent, SecondNumber=deconstruct_vector_2.XComponent)  # -> Equality, Inequality
equality_2 = Equality(FirstNumber=deconstruct_vector.YComponent, SecondNumber=deconstruct_vector_2.YComponent)  # -> Equality, Inequality
equality_3 = Equality(FirstNumber=deconstruct_vector.ZComponent, SecondNumber=deconstruct_vector_2.ZComponent)  # -> Equality, Inequality
gate_and = GateAnd(A=equality.Equality, B=equality_2.Equality, C=equality_3.Equality)  # -> simplify(Result)
flip_curve = FlipCurve(Curve=close_curve_2.Closed)  # -> simplify(Curve), Flag
cull_pattern_2 = CullPattern(List=flip_curve.Curve, CullPattern=invert(gate_and))  # -> simplify(List)
cull_pattern_3 = CullPattern(List=close_curve_2.Closed, CullPattern=gate_and)  # -> simplify(List)
merge_2 = Merge(Data1=cull_pattern_3, Data2=cull_pattern_2)

# ---- group: BOUNDARY GENERATOR / Minimum distance from end effector to existing structure (continued)
offset_curve = OffsetCurve(Curve=merge_2, Distance=minimum_distance_to_keep_from_existing_s, Plane=plane, Corners=2)  # -> simplify(Curve)

# ---- group: BOUNDARY GENERATOR / Security distance offset
curve_5 = Curve(flatten(offset_curve))

# ---- group: FIND MAIN INTERSECTION POINTS WITH TARGET SHAPE AND TARGET BOUNDARY / adjusted plane to shapes
area_3 = Area(Geometry=curve_5)  # -> flatten(Area), Centroid
list_item = ListItem(List=area_3.Centroid, Index=0, Wrap=True)
plane_origin = PlaneOrigin(Base=plane, Origin=list_item)

# ---- group: FIND MAIN INTERSECTION POINTS WITH TARGET SHAPE AND TARGET BOUNDARY / FIND INTERSFCTION BETWEEN TARGET CURVE AND PROJECTED POINTS
region_union = RegionUnion(Curves=curve_3, Plane=plane_origin)
curve_curve = CurveCurve(CurveA=reparameterize(curve), CurveB=reparameterize(region_union))  # -> Points, ParamsA, ParamsB
equality_within_tolerance = EqualityWithinTolerance(FirstNumber=curve_curve.ParamsA, SecondNumber="0", Tolerance=state_0_tolerance_for_undetection_at_sta)  # -> Equality, Inequality
equality_within_tolerance_2 = EqualityWithinTolerance(FirstNumber=curve_curve.ParamsA, SecondNumber="1", Tolerance=state_0_tolerance_for_undetection_at_sta)  # -> Equality, Inequality
gate_and_2 = GateAnd(A=equality_within_tolerance.Inequality, B=equality_within_tolerance_2.Inequality)
cull_pattern_4 = CullPattern(List=curve_curve.Points, CullPattern=gate_and_2)
average = Average(Input=cull_pattern_4)  # -> simplify(ArithmeticMean)

# ---- group: FIND MAIN INTERSECTION POINTS WITH TARGET SHAPE AND TARGET BOUNDARY / INTERSECTION WITH HIGHEST POINT OF THE CURVE / Line for intersection
move = Move(Geometry=average, Motion=deconstruct_plane.YAxis)  # -> Geometry, Transform
line = Line(StartPoint=average, EndPoint=move.Geometry)

# ---- group: FIND MAIN INTERSECTION POINTS WITH TARGET SHAPE AND TARGET BOUNDARY / INTERSECTION WITH BOUNDARY CURVE / Line for intersection
move_2 = Move(Geometry=average, Motion=deconstruct_plane.YAxis)  # -> Geometry, Transform
line_2 = Line(StartPoint=average, EndPoint=move_2.Geometry)

# ---- group: FIND MAIN INTERSECTION POINTS WITH TARGET SHAPE AND TARGET BOUNDARY / INTERSECTION WITH HIGHEST POINT OF THE CURVE
curve_line = CurveLine(Curve=region_union, Line=line)  # -> Points, Params, Count
deconstruct = Deconstruct(Point=curve_line.Points)  # -> XComponent, YComponent, ZComponent
sort_list = SortList(Keys=deconstruct.ZComponent, ValuesValuesA=curve_line.Points)  # -> Keys, reverse(ValuesValuesA)
list_item_2 = ListItem(List=sort_list.ValuesValuesA, Index=0, Wrap=True)

# ---- group: BOUNDARY GENERATOR (continued)
region_union_2 = RegionUnion(Curves=curve_5, Plane=plane_origin)  # -> simplify(graft(Result))

# ---- group: FIND MAIN INTERSECTION POINTS WITH TARGET SHAPE AND TARGET BOUNDARY / INTERSECTION WITH BOUNDARY CURVE
curve_line_2 = CurveLine(Curve=region_union_2, Line=line_2)  # -> Points, Params, Count
deconstruct_2 = Deconstruct(Point=curve_line_2.Points)  # -> XComponent, YComponent, ZComponent
sort_list_2 = SortList(Keys=deconstruct_2.ZComponent, ValuesValuesA=curve_line_2.Points)  # -> Keys, reverse(ValuesValuesA)
list_item_3 = ListItem(List=sort_list_2.ValuesValuesA, Index=0, Wrap=True)

# ---- group: FIND MAIN INTERSECTION POINTS WITH TARGET SHAPE AND TARGET BOUNDARY / Target point on shape
point = Point(list_item_2)

# ---- group: FIND MAIN INTERSECTION POINTS WITH TARGET SHAPE AND TARGET BOUNDARY / Target point on boundary
point_2 = Point(list_item_3)

# ---- group: Main corrected outline
curve_6 = Curve(region_union)

# ---- group: Main boundary curve
curve_7 = Curve(region_union_2)

# ---- group: TARGET DROPPOING POINTS / Target point on shape
point_3 = Point(point)

# ---- group: TARGET DROPPOING POINTS / Target point on boundary
point_4 = Point(point_2)
