# Grasshopper definition ControlandCommunication_All.gh (Grasshopper 1.0.7)
# plug-ins: gHowl, Simulacrum, VirtualRobot.Grasshopper, Firefly.Core

unit_z = UnitZ(Factor=1)
point = Point(Point(1557.858054, 217.3422694, 472))
point_2 = Point(Point(1557.858054, -282.6577306, 472))
catenary = Catenary(PointA=point_2, PointB=point, Length=Slider(1000, range=0..1000), Gravity=unit_z)
deconstruct = Deconstruct(Point=point_2)  # -> XComponent, YComponent, ZComponent
construct_point = ConstructPoint(XCoordinate="1652.56", YCoordinate="167.55", ZCoordinate="700.48")
scaling = Slider(0.276, range=0..1)
local_ip = Panel("192.168.0.106")

port = Panel("5000")
local_ip_2 = Panel("141.58.222.34")
udp = UDPReceiver(Address=local_ip, Port=port, Pattern=0)  # -> Info, Data
panel = Panel(udp.Info)
# ReceivingCameraData
replace_text = ReplaceText(Text=udp.Data, Find="[", RecursiveReplace=False)
replace_text_2 = ReplaceText(Text=replace_text, Find="]", RecursiveReplace=False)
text_split = TextSplit(Text=replace_text_2, Separators=",")  # -> simplify(Result)
xz_plane = XZPlane(Origin=Point(0, 0, 0))
number = Number(text_split)
list_length = ListLength(List=number)
division = Division(A=list_length, B="2")
partition_list = PartitionList(List=number, Size=division)  # -> simplify(Chunks)
explode_tree = ExplodeTree(Data=partition_list)  # -> Branch0, Branch1
number_2 = Number(explode_tree.Branch1)
number_3 = Number(explode_tree.Branch0)
construct_point_2 = ConstructPoint(XCoordinate=number_3, YCoordinate=number_2, ZCoordinate=0)
mirror = Mirror(Geometry=construct_point_2, Plane=xz_plane)  # -> Geometry, Transform
polyline = PolyLine(Vertices=mirror.Geometry, Closed=True)
area = Area(Geometry=polyline)  # -> Area, Centroid

point_3 = Point(area.Centroid)
deconstruct_2 = Deconstruct(Point=point_3)  # -> XComponent, YComponent, ZComponent
com_ports_available = COMPortsAvailable()
deconstruct_3 = Deconstruct(Point=point_3)  # -> XComponent, YComponent, ZComponent

claws = Slider(0, range=0..100)
nozle_cover = Slider(180, range=0..180)
enableservos_light = BooleanToggle(False)
vent = Button()
nozzle = Button()
uv_light = Button()
motor = BooleanToggle(False)
gate_not = GateNot(A=Toggle(False))
gate_not_2 = GateNot(A=Toggle(True))

construct_point_3 = ConstructPoint(XCoordinate=deconstruct_2.XComponent, YCoordinate=0, ZCoordinate=deconstruct_2.YComponent)
construct_point_4 = ConstructPoint(XCoordinate=0, YCoordinate=deconstruct_3.XComponent, ZCoordinate=deconstruct_3.YComponent)

# ----
# Finetune Servos
panel_2 = Panel("0")
construct_domain = ConstructDomain(DomainStart="0", DomainEnd="178")
construct_domain_2 = ConstructDomain(DomainStart=panel_2, DomainEnd="100")
remap_numbers = RemapNumbers(Value=claws, Source=construct_domain_2, Target=construct_domain)  # -> Mapped, Clipped
integer = Integer(remap_numbers.Mapped)

construct_domain_3 = ConstructDomain(DomainStart="0", DomainEnd="165")
construct_domain_4 = ConstructDomain(DomainStart="0", DomainEnd="100")
remap_numbers_2 = RemapNumbers(Value=claws, Source=construct_domain_4, Target=construct_domain_3)  # -> Mapped, Clipped
integer_2 = Integer(remap_numbers_2.Mapped)

construct_domain_5 = ConstructDomain(DomainStart="0", DomainEnd="170")
construct_domain_6 = ConstructDomain(DomainStart="0", DomainEnd="100")
remap_numbers_3 = RemapNumbers(Value=claws, Source=construct_domain_6, Target=construct_domain_5)  # -> Mapped, Clipped
integer_3 = Integer(remap_numbers_3.Mapped)

unit_y = UnitY(Factor="167.55")
unit_z_2 = UnitZ(Factor=Slider(1302, range=1000..2000))
unit_x = UnitX(Factor=Slider(877, range=800..1500))
list_item = ListItem(List=com_ports_available, Index=0, Wrap=True)  # -> Item, Item1, Item2
xy_plane = XYPlane(Origin=point_3)
xz_plane_2 = XZPlane(Origin=construct_point_3)
xy_plane_2 = XYPlane(Origin=point_3)
yz_plane = YZPlane(Origin=construct_point_4)
panel_3 = Panel(list_item.Item2)
unit_z_3 = UnitZ(Factor=Slider(302, range=0..1000))
orient = Orient(Geometry=mirror.Geometry, Source=xy_plane_2, Target=yz_plane)  # -> Geometry, Transform
orient_2 = Orient(Geometry=mirror.Geometry, Source=xy_plane, Target=xz_plane_2)  # -> Geometry, Transform
number_slider = Slider(115, range=0..120)

# ---- group: PickUp
construct_point_5 = ConstructPoint(XCoordinate="1623.53", YCoordinate="-719.37", ZCoordinate="875.28")

# ---- group: prePickUp
construct_point_6 = ConstructPoint(XCoordinate="1623.53", YCoordinate="-719.37", ZCoordinate="1106.73")

# ----
polyline_2 = PolyLine(Vertices=orient_2.Geometry, Closed=True)
open_close_port = OpenClosePort(OpenClosePort=Toggle(True), PortNumber=panel_3, BaudRate=115200)
polyline_3 = PolyLine(Vertices=orient.Geometry, Closed=True)
area_2 = Area(Geometry=polyline_2)  # -> Area, Centroid
area_3 = Area(Geometry=polyline_3)  # -> Area, Centroid
unit_x_2 = UnitX(Factor=expr("-x", number_slider))
unit_x_3 = UnitX(Factor=number_slider)

# ---- group: left
point_4 = Point(<point referenced from the Rhino model>)

# ---- group: right
point_5 = Point(<point referenced from the Rhino model>)

# ----
panel_4 = Panel(open_close_port)
scale = Scale(Geometry=orient_2.Geometry, Center=area_2.Centroid, Factor=scaling)  # -> Geometry, Transform
move = Move(Geometry=scale.Geometry, Motion=unit_y)  # -> Geometry, Transform
move_2 = Move(Geometry=move.Geometry, Motion=unit_z_2)  # -> Geometry, Transform
move_3 = Move(Geometry=move_2.Geometry, Motion=unit_x)  # -> Geometry, Transform
polyline_4 = PolyLine(Vertices=move_3.Geometry, Closed=True)
area_4 = Area(Geometry=polyline_4)  # -> Area, Centroid
point_6 = Point(area_4.Centroid)
move_4 = Move(Geometry=point_6, Motion=unit_z_3)  # -> Geometry, Transform

# ---- group: DropOffPoint
point_7 = Point(move_4.Geometry)

# ----
move_5 = Move(Geometry=point_4, Motion=unit_x_3)  # -> Geometry, Transform
move_6 = Move(Geometry=point_5, Motion=unit_x_2)  # -> Geometry, Transform
uno_write = UnoWrite(
    StartWritingValues=Toggle(False),
    _13ServoEnable=enableservos_light,
    DigitalPin12=gate_not,
    DigitalPin11=motor,
    DigitalPin10=uv_light,
    DigitalPin9=integer,
    DigitalPin8=gate_not_2,
    _6NozzleCover=nozle_cover,
    DigitalPin5=integer_2,
    DigitalPin3=integer_3,
    PortNumber=panel_3)  # -> ArduinoOutput, StatusMessage
unit_z_4 = UnitZ(Factor=Slider(280, range=0..300))
unit_z_5 = UnitZ(Factor=Slider(275, range=0..300))
X = UnitX(Factor=expr("-x", 1))
move_7 = Move(Geometry=move_6.Geometry, Motion=unit_z_4)  # -> Geometry, Transform
move_8 = Move(Geometry=move_5.Geometry, Motion=unit_z_5)  # -> Geometry, Transform
panel_5 = Panel(area.Centroid)
panel_6 = Panel(partition_list)
pl = PlaneNormal(Origin=point_7, ZAxis=X)
gframe = GetFrame(Frame=pl)  # -> XYZLocation, ABCOrientation
pdecon = Deconstruct(Point=gframe.XYZLocation)  # -> XComponent, YComponent, ZComponent
pdecon_2 = Deconstruct(Point=gframe.ABCOrientation)  # -> XComponent, YComponent, ZComponent
cancel = Button()
ghpython_script = GhPythonScript(
    x=pdecon.XComponent,
    y=pdecon.YComponent,
    z=pdecon.ZComponent,
    A=pdecon_2.XComponent,
    B=pdecon_2.YComponent,
    C=pdecon_2.ZComponent)  # -> out, a
# ---------- ghpython_script: Python ----------
f = " "
f = "{POS: X " , x , ", Y " , y , ", Z " , z , ", A " , A , ", B " , B , ", C " , C , "}"
a = f
# ---------- end ghpython_script ----------
kr_210 = Panel("141.58.154.149")
panel_7 = Panel("192.168.140.128")
text_join = TextJoin(Text=ghpython_script.a)
gotopickup = Button()
atpickup = Button()
pickup = Button()
gotodropoff = Button()
attarget = Button()
pressurizing = Button()
opennozzle = Button()
spray = Button()
closenozzle = Button()
openidle = Button()
start_curing = Button()
closeidle = Button()
panel_8 = Panel(text_join)
client = TCPClient(ServerIP=kr_210, ServerPort="7000", ConnectionTrigger=Toggle(True))

uno_read = UnoRead(StartReadingValues=Toggle(True), PortNumber=panel_3)  # -> AnalogPin0, AnalogPin1, AnalogPin2, AnalogPin3, AnalogPin4, AnalogPin5, DigitalPin2, DigitalPin4, DigitalPin7, StatusMessage
trigger = Trigger(Interval=10, TimerInterval=10, Target=uno_read)

panel_9 = Panel(uno_read.AnalogPin1)
value_list = ValueList({"Open Idle": 0, "Closed Idle": 1, "Gripping": 2, "Dropping": 3, "Pressurize": 4, "SprayStart": 5, "UV On": 6, "SprayEnd": 8, "All Off": 7}, selected="All Off")
in_seconds = Slider(59, range=0..100)
python = GhPythonScript(
    P=gotopickup,
    U=atpickup,
    Z=pickup,
    D=gotodropoff,
    T=attarget,
    O=openidle,
    C=closeidle,
    Y=pressurizing,
    A=opennozzle,
    B=closenozzle,
    Q=cancel)  # -> out, a, b; inputs P: Boolean, U: Boolean, Z: Boolean, D: Boolean, T: Boolean, O: Boolean, C: Boolean, A: Boolean, B: Boolean, Q: Boolean
# ---------- python: Python ----------
check = False
if P:
    a = "\"P\""
if U:
    a = "\"U\""
if Z:
    a = "\"Z\""
if D:
    a = "\"D\""
if T:
    a = "\"T\""
if O:
    a = "\"O\""
if C:
    a = "\"C\""
if Y:
    a = "\"Y\""
if A:
    a = "\"A\""
if B:
    a = "\"B\""
if Q:
    a = "\"Q\""


if a != None:
    check = True
    
b = check
# ---------- end python ----------
timer = Timer(Interval=1000, TimerInterval=1000, Target=[python_3, python_2])
start_spraying = Button()
in_seconds_2 = Slider(5, range=0..100)
toggle = BooleanToggle(True)

# ---- group: Write Values
custom_write = KRCWrite(Socket=client, Write="MyBool", Input=Toggle(True), Run=toggle, RefreshRate=20)
panel_10 = Panel(custom_write)

custom_write_2 = KRCWrite(Socket=client, Write="MSG", Input=python.a, Run=python.b, RefreshRate=20)
panel_11 = Panel(custom_write_2)

custom_write_3 = KRCWrite(Socket=client, Write="AVAILABLE", Input=python.b, Run=python.b, RefreshRate=20)
panel_12 = Panel(custom_write_3)

# ---- group: Read Values
custom_read = KRCRead(Socket=client, VarRead="STATE", ReadTrigger=Toggle(True), RefreshRate=20)
panel_13 = Panel(custom_read)

# ----
gate_not_3 = GateNot(A=spray)
panel_14 = Panel(python.b)
python_2 = GhPythonScript(iTime=in_seconds_2, iReset=start_spraying)  # -> out, oX; inputs iReset: Boolean
# ---------- python_2: Python ----------
import Rhino.Geometry as rg






if iReset:
    
    level = 0
else:
    level += 1



if level < iTime:
    x = False
elif level >= iTime: 
    x = True

print level
oX = x
# ---------- end python_2 ----------
python_3 = GhPythonScript(iTime=in_seconds, iReset=start_curing)  # -> out, oX; inputs iReset: Boolean
# ---------- python_3: Python ----------
import Rhino.Geometry as rg






if iReset:
    
    level = 0
else:
    level += 1



if level < iTime:
    x = True
elif level >= iTime: 
    x = False

print level
oX = x
# ---------- end python_3 ----------
read_position = ReadActPos(Socket=client, Run=Toggle(True), RefreshRate="50")  # -> AxisValues, TCPPlane, XYZ, ABC, E6POS, E6AXIS
krc_write = KRCWrite(Socket=client, Write="MyPos", Input=text_join, Run=toggle, RefreshRate=100)
monitor = NetstatMonitor(Socket=client)
panel_15 = Panel([python_3.oX, python_3.out])
panel_16 = Panel([python_2.oX, python_2.out])
panel_17 = Panel(read_position.XYZ)
panel_18 = Panel(krc_write)
deconstruct_plane = DeconstructPlane(Plane=read_position.TCPPlane)  # -> Origin, XAxis, YAxis, ZAxis
distance = Distance(PointA=deconstruct_plane.Origin, PointB=point_7)
distance_2 = Distance(PointA=deconstruct_plane.Origin, PointB=construct_point_5)
smaller_than = SmallerThan(FirstNumber=distance_2, SecondNumber="0.01")  # -> SmallerThan, OrEqualTo
smaller_than_2 = SmallerThan(FirstNumber=distance, SecondNumber="0.01")  # -> SmallerThan, OrEqualTo
replace_text_3 = ReplaceText(Text=panel_13, Find="\"", RecursiveReplace=False)

# ---- group: Check Connection
panel_19 = Panel(monitor)

# ----
flip_plane = FlipPlane(Plane=pl, ReverseX=False, ReverseY=False, SwapAxes=True)

pln = Plane(read_position.TCPPlane)
predefined_kuka_kr_125_2 = PredefinedKUKAKR1252(RobRootFrame=PlaneXY(0, 0, 0))
robot_inverse_kinematics = RobotInverseKinematics(Robot=predefined_kuka_kr_125_2, TargetTCPFrame=flip_plane, AxisToggles=[False, False, False], useColorPreview=True)  # -> PoseGeometry, AxisValues, AxisFrames

integer_4 = Integer(replace_text_3)
panel_20 = Panel(integer_4)
number_4 = Number(integer_4)
ghpython_script_2 = GhPythonScript(iSetState=number_4, iPressure=uno_read.AnalogPin1)  # -> out, oServoEnable, oSpray, oPump, oUV, oGripper, oVent, oCover; inputs iPressure: Int32
# ---------- ghpython_script_2: Python ----------
__author__ = "Deus Artifex"
__version__ = "2022.02.07"

import rhinoscriptsyntax as rs
import time



if iSetState == 0:#OpenIdle
    oServoEnable = True
    oSpray = True
    oGripper = 30
    oCover = 180
    oUV = False
    oPump = False# invertet! -Its on!
    oVent = False# invertet! -Its on!
    
elif iSetState == 1:#ClosedIdle
    oServoEnable = True
    oSpray = True
    oGripper = 100
    oCover = 180
    oUV = False
    oPump = False# invertet! -Its on!
    oVent = False# invertet! -Its on!

elif iSetState == 2:#Gripping
    oServoEnable = True
    oSpray = True 
    oGripper = 100
    oCover = 180
    oUV = False
    oPump = True# invertet! -Its on!
    oVent = True# invertet! -Its on!

elif iSetState == 3:#Dropping
    oServoEnable = True
    oSpray = True 
    oGripper = 20
    oCover = 180
    oUV = False
    oPump = True# invertet! -Its on!
    oVent = True# invertet! -Its on!

elif iSetState == 4:#Pressurize
    oServoEnable = False
    oSpray = True 
    oGripper = 20
    oCover = 180
    oUV = False
    oVent = True
    if (iPressure <= 200):
        oPump = False
    if(iPressure >= 200):
        oPump = True
elif iSetState == 5:#sprayStart
    oServoEnable = True
    oSpray = True 
    oGripper = 20
    oCover = 20
    oUV = False
    oPump = True# invertet! -Its on!
    oVent = True# invertet! -Its on!

elif iSetState == 8:#sprayEnd 
    oServoEnable = True
    oSpray = True 
    oGripper = 20
    oCover = 180
    oUV = False
    oPump = True# invertet! -Its on!
    oVent = True# invertet! -Its on!

elif iSetState == 6:#UVOn
    oServoEnable = False
    oSpray = True 
    oGripper = 20
    oCover = 0
    oUV = True
    oPump = False# invertet! -Its on!
    oVent = False# invertet! -Its on!

elif iSetState == 7:#alloff
    oServoEnable = False
    oSpray = True 
    oGripper = 20
    oCover = 180
    oUV = False
    oPump = True# invertet! -Its on!
    oVent = False# invertet! -Its on!
# ---------- end ghpython_script_2 ----------
cluster = Cluster(value_2=ghpython_script_2.oGripper, value=ghpython_script_2.oGripper, value_3=ghpython_script_2.oGripper)  # -> integer_4, integer_5, integer_6
uno_write_2 = UnoWrite(
    StartWritingValues=Toggle(True),
    _13ServoEnable=ghpython_script_2.oServoEnable,
    DigitalPin12=gate_not_3,
    DigitalPin11=ghpython_script_2.oPump,
    DigitalPin10=python_3.oX,
    DigitalPin9=cluster.integer_4,
    DigitalPin8=ghpython_script_2.oVent,
    _6NozzleCover=ghpython_script_2.oCover,
    DigitalPin5=cluster.integer_5,
    DigitalPin3=cluster.integer_6,
    PortNumber=panel_3)  # -> ArduinoOutput, StatusMessage

scaling_2 = Slider(0.498, range=0..1)
unit_z_6 = UnitZ(Factor=Slider(1239, range=1000..2000))
unit_x_4 = UnitX(Factor=deconstruct.XComponent)
unit_y_2 = UnitY(Factor=Slider(-672, range=-1000..-500))
unit_z_7 = UnitZ(Factor=Slider(304, range=0..1000))

scale_2 = Scale(Geometry=orient.Geometry, Center=area_3.Centroid, Factor=scaling_2)  # -> Geometry, Transform

move_9 = Move(Geometry=scale_2.Geometry, Motion=unit_x_4)  # -> Geometry, Transform
move_10 = Move(Geometry=move_9.Geometry, Motion=unit_z_6)  # -> Geometry, Transform
move_11 = Move(Geometry=move_10.Geometry, Motion=unit_y_2)  # -> Geometry, Transform
polyline_5 = PolyLine(Vertices=move_11.Geometry, Closed=True)
area_5 = Area(Geometry=polyline_5)  # -> Area, Centroid
point_8 = Point(area_5.Centroid)
move_12 = Move(Geometry=point_8, Motion=unit_z_7)  # -> Geometry, Transform

# ---- group: dropOffPoint
point_9 = Point(move_12.Geometry)

# ==== cluster Cluster
value = ClusterInput()

construct_domain = ConstructDomain(DomainStart="0", DomainEnd="165")
construct_domain_2 = ConstructDomain(DomainStart="0", DomainEnd="100")
remap_numbers = RemapNumbers(Value=value, Source=construct_domain_2, Target=construct_domain)  # -> Mapped, Clipped
integer = Integer(remap_numbers.Mapped)

value_2 = ClusterInput()

# ----
# Finetune Servos
panel = Panel("0")
construct_domain_3 = ConstructDomain(DomainStart="0", DomainEnd="178")
construct_domain_4 = ConstructDomain(DomainStart=panel, DomainEnd="100")
remap_numbers_2 = RemapNumbers(Value=value_2, Source=construct_domain_4, Target=construct_domain_3)  # -> Mapped, Clipped
integer_2 = Integer(remap_numbers_2.Mapped)

value_3 = ClusterInput()

construct_domain_5 = ConstructDomain(DomainStart="0", DomainEnd="170")
construct_domain_6 = ConstructDomain(DomainStart="0", DomainEnd="100")
remap_numbers_3 = RemapNumbers(Value=value_3, Source=construct_domain_6, Target=construct_domain_5)  # -> Mapped, Clipped
integer_3 = Integer(remap_numbers_3.Mapped)

integer_4 = ClusterOutput(integer_2)
integer_5 = ClusterOutput(integer)
integer_6 = ClusterOutput(integer_3)
